% Simulink data dictionary dictionary_srf_pll.sldd

BW = 2010.619
NF_s = tf(num={[1 0 394784.2]}, den={[1 2010.619 394784.2]}, Ts=0)
NF_z = tf(num={[1 -1.999844 0.999999]}, den={[1 -1.960431 0.9605854]}, Ts=2.0e-5)
h_g_s = tf(num={[250 20000]}, den={[1 0]}, Ts=0)
h_g_z = tf(num={[250.2 -249.8]}, den={[1 -1]}, Ts=2.0e-5)
h_g_z2 = tf(num={[252 -248]}, den={[1 -1]}, Ts=0.0002)
kii = 20000
kpp = 250
q = 0.3125
t = [0 0.0002 0.0004 0.0006 0.0008 0.001 0.0012 0.0014 0.0016 0.0018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 0.15]
tsample = 0.0002
tsim = 0.15
wo = 628.3185
Configuration = Simulink.ConfigSet(StartTime="0", StopTime="1/5", FixedStep="tsample/20", Solver="ode4", ProdHWDeviceType="Intel->x86-64 (Windows64)", SystemTargetFile="ert.tlc", TargetLang="C")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
NF_z2 = tf(num={[1 -1.986146 0.9991316]}, den={[1 -1.655913 0.6688979]}, Ts=0.0002)